# Grasshopper definition Gcode.gh (Grasshopper 1.0.8)

# Input a curve here
curve = Curve(<curve referenced from the Rhino model>)

# ---- group: PrintingBoundary
# Check the start point
# Flip the curve when necessary
Z = Slider(256, range=0..1000)
# Bambu A1
rectangle = Rectangle(Plane=PlaneXY(0, 0, 0), XSize=Slider(256, range=0..1000), YSize=Slider(256, range=0..1000), Radius=0)  # -> Rectangle, Length
box_rectangle = BoxRectangle(Rectangle=rectangle.Rectangle, Height=Z)

# ----
flip_curve = FlipCurve(Curve=curve)  # -> Curve, Flag

# ---- group: Extrusion Rate
e2 = Slider(0.01925, range=0..10)
e1 = Slider(0, range=0..10)
construct_point = ConstructPoint(XCoordinate=Slider(123.95, range=0..1000), YCoordinate=Slider(124.374, range=0..1000), ZCoordinate=0)
construct_point_2 = ConstructPoint(XCoordinate=Slider(124.377, range=0..1000), YCoordinate=Slider(123.95, range=0..1000), ZCoordinate=0)
subtraction = Subtraction(A=e2, B=e1)
# Bambu A1
distance = Distance(PointA=construct_point, PointB=construct_point_2)
division = Division(A=subtraction, B=distance)
multiplication = Multiplication(A=division, B=Slider(1.2, range=0..10))

# ----
curve_2 = Curve(curve)
divide_length = DivideLength(Curve=curve_2, Length=Slider(0.3, range=0..1))  # -> Points, Tangents, Parameters
list_item = ListItem(List=divide_length.Points, Index=Slider(113, range=0..550), Wrap=True)
interpolate = Interpolate(Vertices=flatten(divide_length.Points), Degree=expr("1", 1), Periodic=False, KnotStyle=1)  # -> Curve, Length, Domain
explode = Explode(Curve=interpolate.Curve, Recursive=True)  # -> Segments, Vertices
point = Point(flatten(explode.Vertices))
length = Length(Curve=explode.Segments)
deconstruct = Deconstruct(Point=point)  # -> XComponent, YComponent, ZComponent
list_item_2 = ListItem(List=point, Index=0, Wrap=True)
deconstruct_2 = Deconstruct(Point=list_item_2)  # -> XComponent, YComponent, ZComponent
addition = Addition(A=deconstruct_2.ZComponent, B="0.2")
addition_2 = Addition(A=deconstruct.ZComponent, B="0.2")
concatenate = Concatenate(
    Fragment_A="G0 F18000",
    X=" X",
    Xnum=deconstruct_2.XComponent,
    Y=" Y",
    Ynum=deconstruct_2.YComponent,
    Z=" Z",
    Znum=addition)
# Bambu A1 Start G-code
panel = Panel(""";===== machine: A1 =========================
;===== date: 20260513 ==================
G392 S0
M9833.2
;M400
;M73 P1.717

;===== start to heat heatbead&hotend==========
M1002 gcode_claim_action : 2
M1002 set_filament_type:{filament_type[initial_no_support_extruder]}
M104 S140
M140 S[bed_temperature_initial_layer_single]

;=====start printer sound ===================
M17
M400 S1
M1006 S1
M1006 A0 B10 L100 C37 D10 M60 E37 F10 N60
M1006 A0 B10 L100 C41 D10 M60 E41 F10 N60
M1006 A0 B10 L100 C44 D10 M60 E44 F10 N60
M1006 A0 B10 L100 C0 D10 M60 E0 F10 N60
M1006 A43 B10 L100 C46 D10 M70 E39 F10 N80
M1006 A0 B10 L100 C0 D10 M60 E0 F10 N80
M1006 A0 B10 L100 C43 D10 M60 E39 F10 N80
M1006 A0 B10 L100 C0 D10 M60 E0 F10 N80
M1006 A0 B10 L100 C41 D10 M80 E41 F10 N80
M1006 A0 B10 L100 C44 D10 M80 E44 F10 N80
M1006 A0 B10 L100 C49 D10 M80 E49 F10 N80
M1006 A0 B10 L100 C0 D10 M80 E0 F10 N80
M1006 A44 B10 L100 C48 D10 M60 E39 F10 N80
M1006 A0 B10 L100 C0 D10 M60 E0 F10 N80
M1006 A0 B10 L100 C44 D10 M80 E39 F10 N80
M1006 A0 B10 L100 C0 D10 M60 E0 F10 N80
M1006 A43 B10 L100 C46 D10 M60 E39 F10 N80
M1006 W
M18 
;=====start printer sound ===================

;=====avoid end stop =================
G91
G380 S2 Z40 F1200
G380 S3 Z-15 F1200
G90

;===== reset machine status =================
;M290 X39 Y39 Z8
M204 S6000

M630 S0 P0
G91
M17 Z0.3 ; lower the z-motor current

G90
M17 X0.65 Y1.2 Z0.6 ; reset motor current to default
M960 S5 P1 ; turn on logo lamp
G90
M220 S100 ;Reset Feedrate
M221 S100 ;Reset Flowrate
M73.2   R1.0 ;Reset left time magnitude
;M211 X0 Y0 Z0 ; turn off soft endstop to prevent protential logic problem

;====== cog noise reduction=================
M982.2 S1 ; turn on cog noise reduction

M1002 gcode_claim_action : 13

G28 X
G91
G1 Z5 F1200
G90
G0 X128 F30000
G0 Y254 F3000
G91
G1 Z-5 F1200

M109 S25 H140

M17 E0.3
M83
G1 E10 F1200
G1 E-0.5 F30
M17 D

G28 Z P0 T140; home z with low precision,permit 300deg temperature
M104 S{nozzle_temperature_initial_layer[initial_extruder]}

M1002 judge_flag build_plate_detect_flag
M622 S1
  G39.4
  G90
  G1 Z5 F1200
M623

;M400
;M73 P1.717

;===== prepare print temperature and material ==========
M1002 gcode_claim_action : 24

M400
;G392 S1
M211 X0 Y0 Z0 ;turn off soft endstop
M975 S1 ; turn on

G90
G1 X-28.5 F30000
G1 X-48.2 F3000

M620 M ;enable remap
M620 S[initial_no_support_extruder]A   ; switch material if AMS exist
    M1002 gcode_claim_action : 4
    M400
    M1002 set_filament_type:UNKNOWN
    M109 S[nozzle_temperature_initial_layer]
{if (filament_type[initial_no_support_extruder] == "PLA") && (nozzle_diameter != 0.2)}
    M104 S220
{else}
    M104 S250
{endif}
    M400
    T[initial_no_support_extruder]
    G1 X-48.2 F3000
    M400

{if (filament_type[initial_no_support_extruder] == "PLA") && (nozzle_diameter != 0.2)}
    M620.1 E F{flush_volumetric_speeds[initial_no_support_extruder]/2.4053*60} T220
    M109 S220 ;set nozzle to common flush temp
{else}
    M620.1 E F{flush_volumetric_speeds[initial_no_support_extruder]/2.4053*60} T{flush_temperatures[initial_no_support_extruder]}
    M109 S250 ;set nozzle to common flush temp
{endif}
    M106 P1 S0
    G92 E0
    G1 E50 F200
    M400
    M1002 set_filament_type:{filament_type[initial_no_support_extruder]}
M621 S[initial_no_support_extruder]A

{if (filament_type[initial_no_support_extruder] == "PLA") && (nozzle_diameter != 0.2)}
    M109 S220 H300
{else}
    M109 S{flush_temperatures[initial_no_support_extruder]} H300
{endif}
G92 E0
G1 E50 F200 ; lower extrusion speed to avoid clog
M400
M106 P1 S178
G92 E0
G1 E5 F200
M104 S{nozzle_temperature_initial_layer[initial_no_support_extruder]}
G92 E0
G1 E-0.5 F300

G1 X-28.5 F30000
G1 X-48.2 F3000
G1 X-28.5 F30000 ;wipe and shake
G1 X-48.2 F3000
G1 X-28.5 F30000 ;wipe and shake
G1 X-48.2 F3000

;G392 S0

M400
M106 P1 S0
;===== prepare print temperature and material end =====

;M400
;M73 P1.717

;===== auto extrude cali start =========================
M975 S1
;G392 S1

G90
M83
T1000
G1 X-48.2 Y0 Z10 F10000
M400
M1002 set_filament_type:UNKNOWN

M412 S1 ;  ===turn on  filament runout detection===
M400 P10
M620.3 W1; === turn on filament tangle detection===
M400 S2

M1002 set_filament_type:{filament_type[initial_no_support_extruder]}

;M1002 set_flag extrude_cali_flag=1
M1002 judge_flag extrude_cali_flag

M622 J1
    M1002 gcode_claim_action : 8

    M109 S{nozzle_temperature[initial_extruder]}
    G1 E10 F{outer_wall_volumetric_speed/2.4*60}
    M983 F{outer_wall_volumetric_speed/2.4} A0.3 H[nozzle_diameter]; cali dynamic extrusion compensation

    M106 P1 S255
    M400 S5
    G1 X-28.5 F18000
    G1 X-48.2 F3000
    G1 X-28.5 F18000 ;wipe and shake
    G1 X-48.2 F3000
    G1 X-28.5 F12000 ;wipe and shake
    G1 X-48.2 F3000
    M400
    M106 P1 S0

    M1002 judge_last_extrude_cali_success
    M622 J0
        M983 F{outer_wall_volumetric_speed/2.4} A0.3 H[nozzle_diameter]; cali dynamic extrusion compensation
        M106 P1 S255
        M400 S5
        G1 X-28.5 F18000
        G1 X-48.2 F3000
        G1 X-28.5 F18000 ;wipe and shake
        G1 X-48.2 F3000
        G1 X-28.5 F12000 ;wipe and shake
        M400
        M106 P1 S0
    M623
    
    G1 X-48.2 F3000
    M400
    M984 A0.1 E1 S1 F{outer_wall_volumetric_speed/2.4} H[nozzle_diameter]
    M106 P1 S178
    M400 S7
    G1 X-28.5 F18000
    G1 X-48.2 F3000
    G1 X-28.5 F18000 ;wipe and shake
    G1 X-48.2 F3000
    G1 X-28.5 F12000 ;wipe and shake
    G1 X-48.2 F3000
    M400
    M106 P1 S0
M623 ; end of "draw extrinsic para cali paint"

;G392 S0
;===== auto extrude cali end ========================

;M400
;M73 P1.717

M104 S170 ; prepare to wipe nozzle
M106 S255 ; turn on fan

;===== mech mode fast check start =====================
M1002 gcode_claim_action : 3

G1 X128 Y128 F20000
G1 Z5 F1200
M400 P200
M970.3 Q1 A5 K0 O3
M974 Q1 S2 P0

M970.2 Q1 K1 W58 Z0.1
M974 S2

G1 X128 Y128 F20000
G1 Z5 F1200
M400 P200
M970.3 Q0 A10 K0 O1
M974 Q0 S2 P0

M970.2 Q0 K1 W78 Z0.1
M974 S2

M975 S1
G1 F30000
G1 X0 Y5
G28 X ; re-home XY

G1 Z4 F1200

;===== mech mode fast check end =======================

;M400
;M73 P1.717

;===== wipe nozzle ===============================
M1002 gcode_claim_action : 14

M975 S1
M106 S255 ; turn on fan (G28 has turn off fan)
M211 S; push soft endstop status
M211 X0 Y0 Z0 ;turn off Z axis endstop

;===== remove waste by touching start =====

M104 S170 ; set temp down to heatbed acceptable

M83
G1 E-1 F500
G90
M83

M109 S170
G0 X108 Y-0.5 F30000
G380 S3 Z-5 F1200
G1 Z2 F1200
G1 X110 F10000
G380 S3 Z-5 F1200
G1 Z2 F1200
G1 X112 F10000
G380 S3 Z-5 F1200
G1 Z2 F1200
G1 X114 F10000
G380 S3 Z-5 F1200
G1 Z2 F1200
G1 X116 F10000
G380 S3 Z-5 F1200
G1 Z2 F1200
G1 X118 F10000
G380 S3 Z-5 F1200
G1 Z2 F1200
G1 X120 F10000
G380 S3 Z-5 F1200
G1 Z2 F1200
G1 X122 F10000
G380 S3 Z-5 F1200
G1 Z2 F1200
G1 X124 F10000
G380 S3 Z-5 F1200
G1 Z2 F1200
G1 X126 F10000
G380 S3 Z-5 F1200
G1 Z2 F1200
G1 X128 F10000
G380 S3 Z-5 F1200
G1 Z2 F1200
G1 X130 F10000
G380 S3 Z-5 F1200
G1 Z2 F1200
G1 X132 F10000
G380 S3 Z-5 F1200
G1 Z2 F1200
G1 X134 F10000
G380 S3 Z-5 F1200
G1 Z2 F1200
G1 X136 F10000
G380 S3 Z-5 F1200
G1 Z2 F1200
G1 X138 F10000
G380 S3 Z-5 F1200
G1 Z2 F1200
G1 X140 F10000
G380 S3 Z-5 F1200
G1 Z2 F1200
G1 X142 F10000
G380 S3 Z-5 F1200
G1 Z2 F1200
G1 X144 F10000
G380 S3 Z-5 F1200
G1 Z2 F1200
G1 X146 F10000
G380 S3 Z-5 F1200
G1 Z2 F1200
G1 X148 F10000
G380 S3 Z-5 F1200

G1 Z5 F30000
;===== remove waste by touching end =====

G1 Z10 F1200
G0 X118 Y261 F30000
G1 Z5 F1200
M109 S{nozzle_temperature_initial_layer[initial_extruder]-50}

G28 Z P0 T300; home z with low precision,permit 300deg temperature
G29.2 S0 ; turn off ABL
M104 S140 ; prepare to abl
G0 Z5 F20000

G0 X128 Y261 F20000  ; move to exposed steel surface
G0 Z-1.01 F1200      ; stop the nozzle

G91
G2 I1 J0 X2 Y0 F2000.1
G2 I-0.75 J0 X-1.5
G2 I1 J0 X2
G2 I-0.75 J0 X-1.5
G2 I1 J0 X2
G2 I-0.75 J0 X-1.5
G2 I1 J0 X2
G2 I-0.75 J0 X-1.5
G2 I1 J0 X2
G2 I-0.75 J0 X-1.5
G2 I1 J0 X2
G2 I-0.75 J0 X-1.5
G2 I1 J0 X2
G2 I-0.75 J0 X-1.5
G2 I1 J0 X2
G2 I-0.75 J0 X-1.5
G2 I1 J0 X2
G2 I-0.75 J0 X-1.5
G2 I1 J0 X2
G2 I-0.75 J0 X-1.5

G90
G1 Z10 F1200

;===== brush material wipe nozzle =====

G90
G1 Y250 F30000
G1 X55
G1 Z1.300 F1200
G1 Y262.5 F6000
G91
G1 X-35 F30000
G1 Y-0.5
G1 X45
G1 Y-0.5
G1 X-45
G1 Y-0.5
G1 X45
G1 Y-0.5
G1 X-45
G1 Y-0.5
G1 X45
G1 Z5.000 F1200

G90
G1 X30 Y250.000 F30000
G1 Z1.300 F1200
G1 Y262.5 F6000
G91
G1 X35 F30000
G1 Y-0.5
G1 X-45
G1 Y-0.5
G1 X45
G1 Y-0.5
G1 X-45
G1 Y-0.5
G1 X45
G1 Y-0.5
G1 X-45
G1 Z10.000 F1200

;===== brush material wipe nozzle end =====

G90
;G0 X128 Y261 F20000  ; move to exposed steel surface
G1 Y250 F30000
G1 X138
G1 Y261
G0 Z-1.01 F1200      ; stop the nozzle

G91
G2 I1 J0 X2 Y0 F2000.1
G2 I-0.75 J0 X-1.5
G2 I1 J0 X2
G2 I-0.75 J0 X-1.5
G2 I1 J0 X2
G2 I-0.75 J0 X-1.5
G2 I1 J0 X2
G2 I-0.75 J0 X-1.5
G2 I1 J0 X2
G2 I-0.75 J0 X-1.5
G2 I1 J0 X2
G2 I-0.75 J0 X-1.5
G2 I1 J0 X2
G2 I-0.75 J0 X-1.5
G2 I1 J0 X2
G2 I-0.75 J0 X-1.5
G2 I1 J0 X2
G2 I-0.75 J0 X-1.5
G2 I1 J0 X2
G2 I-0.75 J0 X-1.5

M109 S140
M106 S255 ; turn on fan (G28 has turn off fan)

M211 R; pop softend status

;===== wipe nozzle end ================================

;M400
;M73 P1.717

;===== bed leveling ==================================
M1002 judge_flag g29_before_print_flag

G90
G1 Z5 F1200
G1 X0 Y0 F30000
G29.2 S1 ; turn on ABL

M190 S[bed_temperature_initial_layer_single]; ensure bed temp
M109 S140
M106 S0 ; turn off fan , too noisy

M622 J1
    M1002 gcode_claim_action : 1
    G29 A1 X{first_layer_print_min[0]} Y{first_layer_print_min[1]} I{first_layer_print_size[0]} J{first_layer_print_size[1]}
    M400
    M500 ; save cali data
M623
;===== bed leveling end ================================

;===== home after wipe mouth============================
M1002 judge_flag g29_before_print_flag
M622 J0

    M1002 gcode_claim_action : 13
    G28

M623

;===== home after wipe mouth end =======================

;M400
;M73 P1.717

G1 X108.000 Y-0.500 F30000
G1 Z0.300 F1200
M400
G2814 Z0.32

M104 S{nozzle_temperature_initial_layer[initial_extruder]} ; prepare to print

;===== nozzle load line ===============================
;G90
;M83
;G1 Z5 F1200
;G1 X88 Y-0.5 F20000
;G1 Z0.3 F1200

;M109 S{nozzle_temperature_initial_layer[initial_extruder]}

;G1 E2 F300
;G1 X168 E4.989 F6000
;G1 Z1 F1200
;===== nozzle load line end ===========================

;===== extrude cali test ===============================

M400
    M900 S
    M900 C
    G90
    M83

    M109 S{nozzle_temperature_initial_layer[initial_extruder]}
    G0 X128 E8  F{outer_wall_volumetric_speed/(24/20)    * 60}
    G0 X133 E.3742  F{outer_wall_volumetric_speed/(0.3*0.5)/4     * 60}
    G0 X138 E.3742  F{outer_wall_volumetric_speed/(0.3*0.5)     * 60}
    G0 X143 E.3742  F{outer_wall_volumetric_speed/(0.3*0.5)/4     * 60}
    G0 X148 E.3742  F{outer_wall_volumetric_speed/(0.3*0.5)     * 60}
    G0 X153 E.3742  F{outer_wall_volumetric_speed/(0.3*0.5)/4     * 60}
    G91
    G1 X1 Z-0.300
    G1 X4
    G1 Z1 F1200
    G90
    M400

M900 R

M1002 judge_flag extrude_cali_flag
M622 J1
    G90
    G1 X108.000 Y1.000 F30000
    G91
    G1 Z-0.700 F1200
    G90
    M83
    G0 X128 E10  F{outer_wall_volumetric_speed/(24/20)    * 60}
    G0 X133 E.3742  F{outer_wall_volumetric_speed/(0.3*0.5)/4     * 60}
    G0 X138 E.3742  F{outer_wall_volumetric_speed/(0.3*0.5)     * 60}
    G0 X143 E.3742  F{outer_wall_volumetric_speed/(0.3*0.5)/4     * 60}
    G0 X148 E.3742  F{outer_wall_volumetric_speed/(0.3*0.5)     * 60}
    G0 X153 E.3742  F{outer_wall_volumetric_speed/(0.3*0.5)/4     * 60}
    G91
    G1 X1 Z-0.300
    G1 X4
    G1 Z1 F1200
    G90
    M400
M623

G1 Z0.2

;M400
;M73 P1.717

;========turn off light and wait extrude temperature =============
M1002 gcode_claim_action : 0
M400

;===== for Textured PEI Plate , lower the nozzle as the nozzle was touching topmost of the texture when homing ==
;curr_bed_type={curr_bed_type}
{if curr_bed_type=="Textured PEI Plate"}
G29.1 Z{-0.02} ; for Textured PEI Plate
{endif}

M960 S1 P0 ; turn off laser
M960 S2 P0 ; turn off laser
M106 S0 ; turn off fan
M106 P2 S0 ; turn off big fan
M106 P3 S0 ; turn off chamber fan

M975 S1 ; turn on mech mode supression
G90
M83
T1000

M211 X0 Y0 Z0 ;turn off soft endstop
;G392 S1 ; turn on clog detection
M1007 S1 ; turn on mass estimation
G29.4""")
# Bambu A1 Start G-code（Simplified）
panel_2 = Panel(""";===== A1 minimal start G-code (classroom quick start) =====
;===== Prerequisites:
;=====   1. Filament already loaded from the printer screen
;=====   2. Bed leveling done at least once via screen Calibration
;=====      (this code reuses the stored mesh, no G29)
G392 S0            ; stock: detection toggle, kept as-is
M975 S1            ; vibration compensation on
G90                ; absolute coordinates
M83                ; RELATIVE extrusion for the purge/prime-line below
M220 S100          ; reset speed override
M221 S100          ; reset flow override

;--- start heating bed and nozzle in parallel ---
M1002 gcode_claim_action : 2
M140 S65           ; <-- CHANGE bed temp here
M104 S140          ; nozzle to 140C only - safe for bed-contact Z homing
M109 S140          ; wait for 140C (if nozzle is still hot from last print, let it cool below 140 first)

;--- home ---
M1002 gcode_claim_action : 13
G28                ; home all axes (A1 homes Z by pressing nozzle on the bed)

;--- short purge into the chute, then wipe ---
M211 X0 Y0 Z0      ; soft endstops off (chute is at negative X)
G1 Z10 F1200
G1 X-28.5 F18000
G1 X-48.2 F3000    ; park over the purge chute
M190 S65           ; <-- CHANGE bed temp here (wait)
M109 S220          ; <-- CHANGE nozzle print temp here (wait)
M106 P1 S178       ; fan on so the purge solidifies and drops off
G1 E10 F200        ; purge 10 mm (relative E)
G1 E-1 F300        ; small retract
M400
G1 X-28.5 F18000   ; wipe and shake
G1 X-48.2 F3000
G1 X-28.5 F18000
M400
M106 P1 S0

;--- prime line along the left edge of the bed ---
G1 X3.0 Y20 F18000 ; travel to start point (still at Z10)
G1 Z0.3 F1200      ; drop to first-layer height
G1 E1 F300         ; undo the retract above
G1 Y180 E10 F1500  ; draw first line  (160 mm needs ~E8, E10 is a bit generous on purpose)
G1 X3.4 F18000     ; shift over 0.4 mm
G1 Y20 E10 F1500   ; draw second line back
G1 Z1 F1200        ; lift off the line
G1 X10 F18000      ; quick move away to break the string

M83                ; RELATIVE extrusion mode - matches the generated print files
G92 E0             ; reset E, print body starts from here
;===== end of start G-code =====""")
# Bambu A1 End G-code（Simplified）
# Bambu A1 End G-code
# ;===== date: 20260513 =====================
# G392 S0 ;turn off nozzle clog detect
# 
# M400 ; wait for buffer to clear
# G92 E0 ; zero the extruder
# G90
# G1 Z{max_layer_z + 0.4} F900 ; lower z a little
# G1 X0 Y{first_layer_center_no_wipe_tower[1]} F18000 ; move to safe pos
# G1 X-13.0 F3000 ; move to safe pos
# {if !spiral_mode && print_sequence != "by object"}
# M1002 judge_flag timelapse_record_flag
# M622 J1
# M400 P100
# M971 S11 C11 O0
# M400 P100
# M971 S11 C11 O0
# M400 P100
# M971 S11 C11 O0
# M400 P100
# M971 S11 C11 O0
# M400 P100
# M971 S11 C11 O0
# M400 P100
# M971 S11 C11 O0
# M400 P100
# M971 S11 C11 O0
# M400 P100
# M971 S11 C11 O0
# M400 P100
# M971 S11 C11 O0
# M400 P100
# M971 S11 C11 O0
# M400 P100
# M971 S11 C11 O0
# M400 P100
# M971 S11 C11 O0
# M400 P100
# M971 S11 C11 O0
# M400 P100
# M971 S11 C11 O0
# M400 P100
# M971 S11 C11 O0
# M400 P100
# M971 S11 C11 O0
# M400 P100
# M971 S11 C11 O0
# M400 P100
# M971 S11 C11 O0
# M400 P100
# M971 S11 C11 O0
# M400 P100
# M971 S11 C11 O0
# M400 P100
# M971 S11 C11 O0
# M400 P100
# M971 S11 C11 O0
# M400 P100
# M971 S11 C11 O0
# M400 P100
# M971 S11 C11 O0
# M400 P100
# M971 S11 C11 O0
# M400 P100
# M971 S11 C11 O0
# M400 P100
# M971 S11 C11 O0
# M400 P100
# M971 S11 C11 O0
# M400 P100
# M971 S11 C11 O0
# M400 P100
# M971 S11 C11 O0
# M991 S0 P-1 ;end timelapse at safe pos
# M623
# {endif}
# 
# M140 S0 ; turn off bed
# M106 S0 ; turn off fan
# M106 P2 S0 ; turn off remote part cooling fan
# M106 P3 S0 ; turn off chamber cooling fan
# 
# ;G1 X27 F15000 ; wipe
# 
# ; pull back filament to AMS
# M620 S255
# G1 X267 F15000
# T255
# G1 X-28.5 F18000
# G1 X-48.2 F3000
# G1 X-28.5 F18000
# G1 X-48.2 F3000
# M621 S255
# 
# M104 S0 ; turn off hotend
# 
# M400 ; wait all motion done
# M17 S
# M17 Z0.4 ; lower z motor current to reduce impact if there is something in the bottom
# {if (max_layer_z + 100.0) < 256}
#     G1 Z{max_layer_z + 100.0} F600
#     G1 Z{max_layer_z +98.0}
# {else}
#     G1 Z256 F600
#     G1 Z256
# {endif}
# M400 P100
# M17 R ; restore z current
# 
# G90
# G1 X-48 Y180 F3600
# 
# M220 S100  ; Reset feedrate magnitude
# M201.2 K1.0 ; Reset acc magnitude
# M73.2   R1.0 ;Reset left time magnitude
# M1002 set_gcode_claim_speed_level : 0
# 
# ;=====printer finish  sound=========
# M17
# M400 S1
# M1006 S1
# M1006 A0 B20 L100 C37 D20 M40 E42 F20 N60
# M1006 A0 B10 L100 C44 D10 M60 E44 F10 N60
# M1006 A0 B10 L100 C46 D10 M80 E46 F10 N80
# M1006 A44 B20 L100 C39 D20 M60 E48 F20 N60
# M1006 A0 B10 L100 C44 D10 M60 E44 F10 N60
# M1006 A0 B10 L100 C0 D10 M60 E0 F10 N60
# M1006 A0 B10 L100 C39 D10 M60 E39 F10 N60
# M1006 A0 B10 L100 C0 D10 M60 E0 F10 N60
# M1006 A0 B10 L100 C44 D10 M60 E44 F10 N60
# M1006 A0 B10 L100 C0 D10 M60 E0 F10 N60
# M1006 A0 B10 L100 C39 D10 M60 E39 F10 N60
# M1006 A0 B10 L100 C0 D10 M60 E0 F10 N60
# M1006 A0 B10 L100 C48 D10 M60 E44 F10 N80
# M1006 A0 B10 L100 C0 D10 M60 E0 F10  N80
# M1006 A44 B20 L100 C49 D20 M80 E41 F20 N80
# M1006 A0 B20 L100 C0 D20 M60 E0 F20 N80
# M1006 A0 B20 L100 C37 D20 M30 E37 F20 N60
# M1006 W
# ;=====printer finish  sound=========
# 
# ;M17 X0.8 Y0.8 Z0.5 ; lower motor current to 45% power
# M400
# M18 X Y Z
panel_3 = Panel(""";===== A1 minimal end G-code =====
M400               ; wait for all moves to finish
M83
G92 E0
G1 E-2 F300        ; retract to reduce oozing
M104 S0            ; nozzle heater off
M140 S0            ; bed heater off
M106 P1 S0         ; part fan off
G91
G1 Z10 F1200       ; lift nozzle 10 mm (reduce if the print is near max height 256)
G90
G1 X128 F18000     ; move head to the middle
G1 Y250 F3000      ; slide bed forward to present the print
M400
M18 X Y Z          ; motors off
;===== end =====""")
multiplication_2 = Multiplication(A=length, B=multiplication)
concatenate_2 = Concatenate(
    Fragment_A="G1 F1800",
    X=" X",
    Xnum=deconstruct.XComponent,
    Y=" Y",
    Ynum=deconstruct.YComponent,
    Z=" Z",
    Znum=addition_2,
    E=" E",
    Enum=multiplication_2)
merge = Merge(Data1=flatten(concatenate), Data2=flatten(concatenate_2))
merge_2 = Merge(Data1=flatten(panel_2), Data2=flatten(merge), Data3=flatten(panel_3))
# Output Gcode
panel_4 = Panel(merge_2)
